# Dynamo graph PCCGeneration.dyn (Dynamo 2.13.1.3887)

all_elements_in_active_view = ElementsInView()
floor_types = FloorTypes("150mm Foundation Slab")  # graph input
parameter_name = StringInput("Height Offset From Level")  # graph input
python_script = Python(IN[0]=all_elements_in_active_view, IN[1]=floor_types, IN[2]=parameter_name)  # IronPython2
# ---------- python_script.python (186 lines) ----------
import traceback

import System
from System.Collections.Generic import List

import clr
clr.AddReference('ProtoGeometry')
from Autodesk.DesignScript.Geometry import *

clr.AddReference('RevitAPI')
from Autodesk.Revit.DB import *

clr.AddReference("RevitNodes")
import Revit
clr.ImportExtensions(Revit.Elements)
clr.ImportExtensions(Revit.GeometryConversion)

clr.AddReference('RevitServices')
import RevitServices
from RevitServices.Persistence import DocumentManager
from RevitServices.Transactions import TransactionManager

class CreatePCC :

	__listOfCurves = None
	__floorTypeId = None
	__levelId = None
	__document = None
	
	def __init__(self, curves, floorType, level, document) :
		
		self.__listOfCurves = self.filterEmptyList(curves)
		self.__floorTypeId = floorType.Id
		self.__levelId = level.Id
		self.__document = document
		
	def filterEmptyList(self, curves) :
		
		curveLoops = CurveLoop()

		for iterator in range(len(curves)) :

			curveLoops.Append(curves[iterator]) #  .ToRevitType()
			
		return curveLoops
		
	def createPCC(self) :
		
	
		curveLoops = List[CurveLoop]()
		curveLoops.Add(self.__listOfCurves)

		TransactionManager.Instance.EnsureInTransaction(document)
		
		floor = Floor.Create(self.__document, curveLoops, ElementId(self.__floorTypeId), self.__levelId)
		
		TransactionManager.Instance.TransactionTaskDone()
		
		return floor
		

def getLevel(element) :
	
	if hasattr(element, "LevelId") : return element.Document.GetElement(element.LevelId)
	elif hasattr(element, "Level") : return element.Level

def getBuiltInCategory(categoryId) :
	
	return System.Enum.ToObject(BuiltInCategory, categoryId.IntegerValue)

def getSolids(element) : return element.Geometry()

def getAllSurface(solids) :
	
	allSurfaces = []
	
	for solid in solids :
		
		surfaces = solid.Explode()
		allSurfaces.extend(surfaces)
		
	return allSurfaces

def getRequiredFace(surfaces) :
	
	pointSurfaceDictionary = {}
	for surface in surfaces :
		
		point = surface.PointAtParameter(0.5,0.5)
		z = point.Z
		pointSurfaceDictionary[z] = surface

	minimum = min(pointSurfaceDictionary)
	
	return pointSurfaceDictionary[minimum], minimum
	
def toRevitType(curves) :
	revitCurves = []
	
	for curve in curves :
		
		revitCurves.append(curve.ToRevitType())
	
	return revitCurves
		

def getRequiredBoundryCurves(element) :
	
	solids = getSolids(element)

	if solids :

		surfaces = getAllSurface(solids)

		requiredFace, z = getRequiredFace(surfaces)
	
		perimeterCurves = requiredFace.PerimeterCurves()
	
		revitCurves = toRevitType(perimeterCurves)

		return revitCurves, z
	
	return None, None

def setParameter(element, parameterName, value) :
	
	try :

		element.SetParameterByName(parameterName, value)
		return "Success"

	except : return traceback.format_exc()

allElements = IN[0]
floorType = IN[1]
heightParameterName = IN[2]

OUT = []

revitElements = UnwrapElement(allElements)
document = DocumentManager.Instance.CurrentDBDocument


for iterator in range(len(revitElements)) :
	
	revitElement = revitElements[iterator]
	protoElement = allElements[iterator]
	
	if hasattr(revitElement, "Category") :
		
		category = revitElement.Category 
		
		if category :
			
			categoryId = category.Id
			
			builtInCategory = getBuiltInCategory(categoryId)
			
			if builtInCategory == BuiltInCategory.OST_StructuralFoundation :
				
				level = getLevel(revitElement)
				
				if level :
					
					elevation = level.ToDSType(True).Elevation
					
					objectType = revitElement.GetType().ToString()
					
					
					revitCurves, z = getRequiredBoundryCurves(protoElement)
					
					if revitCurves :
					
						createPCC = CreatePCC(revitCurves, floorType, level, document)
						pcc = createPCC.createPCC()
						protoPCC = pcc.ToDSType(True)

						value = z - elevation

						task = setParameter(protoPCC, heightParameterName, value)
						OUT.append([task, protoElement])
						
					else : 
						
						OUT.append(["Unidentified Element", protoElement])
				
# ----------------------------------------
