# Dynamo graph ParameterOrderUpdate.dyn (Dynamo 2.13.1.3887)

family_types = FamilyTypes("M_Concrete-Rectangular-Column:450 x 600mm")
all_elements_of_family_type = ElementsOfFamilyType(Family_Type=family_types)
parameter_name = StringInput("Comments")
delimiter = StringInput("P")
number = DoubleInput(7)
operand = DoubleInput(-5)
python_script = Python(IN[0]=all_elements_of_family_type, IN[1]=parameter_name, IN[2]=delimiter, IN[3]=number, IN[4]=operand)  # CPython3
# ---------- python_script.python (51 lines) ----------
import clr
clr.AddReference('ProtoGeometry')
from Autodesk.DesignScript.Geometry import *

def stringToASCII(string) :
    
    value = 0
    
    for char in string : value += ord(char)
    
    return value
    
def getSplitValue(string, delimiter) :
    
    valueList = string.split(delimiter)
    valueString = ""
    
    for number in valueList : valueString += number
    if (valueString, int) : return int(valueString)

elements      = IN[0]
parameterName = IN[1]

delimiter     = IN[2]
number        = IN[3]

valueToCheck  = stringToASCII(delimiter + str(number))

operand       = IN[4]

OUT = []

for element in elements :
    
    parameterValue = element.GetParameterValueByName(parameterName)
    
    parameterValueAsASCII = stringToASCII(parameterValue)
    
    if (parameterValueAsASCII > valueToCheck) : 
        
        intValue = getSplitValue(parameterValue, delimiter)
        
        if (intValue) : intValue += operand
        
        else : continue
        
        updatedParameterValue = delimiter + str(intValue)
        
        updatedElement = element.SetParameterByName(parameterName, updatedParameterValue)
        
        OUT.append(element)
# ----------------------------------------
