# Dynamo graph WallOpps.dyn (Dynamo 2.13.1.3887)

get_wall_type = Python()  # CPython3
# ---------- get_wall_type.python (17 lines) ----------
import clr

clr.AddReference('RevitAPI')
from Autodesk.Revit.DB import *
from Autodesk.Revit.DB.Structure import *

clr.AddReference('RevitServices')
import RevitServices
from RevitServices.Persistence import DocumentManager
from RevitServices.Transactions import TransactionManager

document = DocumentManager.Instance.CurrentDBDocument

walls = FilteredElementCollector(document).OfClass(WallType).ToElements()

wallDSType = [wall for wall in walls]
OUT = wallDSType
# ----------------------------------------
python_script = Python()  # CPython3
# ---------- python_script.python (41 lines) ----------
import json
import clr

clr.AddReference('RevitAPI')
from Autodesk.Revit.DB import *
from Autodesk.Revit.DB.Structure import *

def processLocationCurves(start, end) :

    startXYZ = XYZ(float(start["X"]), float(start["Y"]), float(start["Z"]))
    endXYZ   = XYZ(float(end["X"]), float(end["Y"]), float(end["Z"]))
    
    line     = Line.CreateBound(startXYZ, endXYZ)

    return line

file_path = "C:\\Users\\Public\\Documents\\WallData.json"

with open(file_path, 'r') as file:
    data = json.load(file)
    

totalThickness = []
unconnectedHeights = []
locationCurves = []

for item in data :
    
    thickness = float(item["Thickness"])
    totalThickness.append(round(thickness, 1))
    
    start     = item["Start"]
    end       = item["End"]
    
    locationCurve = processLocationCurves(start, end)
    locationCurves.append(locationCurve)
    
    height    = item["Height"]
    unconnectedHeights.append(float(height))
    
OUT = totalThickness, unconnectedHeights, locationCurves, list(set(totalThickness))
# ----------------------------------------
create_duplicate = Python(IN[0]=get_wall_type, IN[1]=python_script)  # CPython3
# ---------- create_duplicate.python (61 lines) ----------
import clr

clr.AddReference('RevitAPI')
from Autodesk.Revit.DB import *
from Autodesk.Revit.DB.Structure import *

clr.AddReference('RevitServices')
import RevitServices
from RevitServices.Persistence import DocumentManager
from RevitServices.Transactions import TransactionManager

def getRequiredWallType(wallTypes) :
    
    for wallType in wallTypes :
        
        wallTypeName = wallType.Name 
        
        if "Generic" in wallTypeName :
            
            return UnwrapElement(wallType)
    
    return None
    
def duplicateWalls(document, thickness, wallTypeRequired) :
    
    duplicatedWallTypes = []
    
    TransactionManager.Instance.EnsureInTransaction(document)
    
    for width in thickness :
        
        width =  UnitUtils.ConvertToInternalUnits(width, UnitTypeId.Feet)

        newWallType = wallTypeRequired.Duplicate("Basic Wall " + str(width))

        compoundStructure = wallTypeRequired.GetCompoundStructure()
        coreLayer = compoundStructure.GetFirstCoreLayerIndex()

        compoundStructure.SetLayerWidth(coreLayer, width)
        
        newWallType.SetCompoundStructure(compoundStructure)
        
        duplicatedWallTypes.append(newWallType)

    TransactionManager.Instance.TransactionTaskDone()
    
    return duplicatedWallTypes

document = DocumentManager.Instance.CurrentDBDocument

wallTypes        = IN[0]
deserializedData = IN[1]

totalThickness = deserializedData[0]
unconnectedHeights = deserializedData[1]
locationCurves = deserializedData[2]
thickness = deserializedData[3]

wallTypeRequired = getRequiredWallType(wallTypes)

OUT = duplicateWalls(document, thickness, wallTypeRequired), thickness, totalThickness, unconnectedHeights, locationCurves
# ----------------------------------------
create_walls = Python(IN[0]=create_duplicate)  # IronPython2
# ---------- create_walls.python (48 lines) ----------
import clr

clr.AddReference('RevitAPI')
from Autodesk.Revit.DB import *
from Autodesk.Revit.DB.Structure import *

clr.AddReference('RevitServices')
import RevitServices
from RevitServices.Persistence import DocumentManager
from RevitServices.Transactions import TransactionManager

def createWalls(document, wallTypes, thickness, totalThickness, unconnectedHeights, locationCurves, level) :

    walls = []
    
    TransactionManager.Instance.EnsureInTransaction(document)
    
    for iterator in range(len(totalThickness)) :
        
        height = unconnectedHeights[iterator]
        height = UnitUtils.ConvertToInternalUnits(height, UnitTypeId.Feet)
        
        locationCurve = locationCurves[iterator]
        
        width = totalThickness[iterator]
        requiredIndex = thickness.index(width)
        
        wallType = UnwrapElement(wallTypes[requiredIndex])
        
        wall = Wall.Create(document, locationCurve, wallType.Id, level.Id, height, 0.0, False, False)
        # parameter = wall.LookupParameter("Unconnected Height")
        
        walls.append(wall)

    TransactionManager.Instance.TransactionTaskDone()
        
wallData = IN[0]

wallTypes = wallData[0]
thickness = wallData[1]
totalThickness = wallData[2]
unconnectedHeights = wallData[3]
locationCurves = wallData[4]

document = DocumentManager.Instance.CurrentDBDocument
level = FilteredElementCollector(document).OfClass(Level).FirstElement()

OUT = createWalls(document, wallTypes, thickness, totalThickness, unconnectedHeights, locationCurves, level)
# ----------------------------------------
join_geometry = Python(IN[0]=create_walls)  # CPython3; frozen
# ---------- join_geometry.python (40 lines) ----------
import clr

clr.AddReference('RevitAPI')
from Autodesk.Revit.DB import *
from Autodesk.Revit.DB.Structure import *

clr.AddReference('RevitServices')
import RevitServices
from RevitServices.Persistence import DocumentManager
from RevitServices.Transactions import TransactionManager

document = DocumentManager.Instance.CurrentDBDocument

# walls = FilteredElementCollector(document, document.ActiveView.Id)
# walls.OfClass(Wall).ToElements()

wallsList = UnwrapElement(IN[0])

# wallsList = list(walls)

TransactionManager.Instance.EnsureInTransaction(document)

for iterator in range(len(wallsList)) :
    
    try :
    
        wall = wallsList[iterator]
        boundingBox = wall.get_BoundingBox(document.ActiveView)
        outline = Outline(boundingBox.Min, boundingBox.Max)
        
        bbFilter = BoundingBoxIntersectsFilter(outline)
        walls.WherePasses(bbFilter)
        
        for walln in walls : JoinGeometryUtils.JoinGeometry(document, wall, walln)
    
    except : pass
    
TransactionManager.Instance.TransactionTaskDone()

OUT = walls
# ----------------------------------------
