# Dynamo graph WallOpps_DataSerialization.dyn (Dynamo 2.13.1.3887)

serialization = Python()  # CPython3
# ---------- serialization.python (103 lines) ----------
import json
import clr

clr.AddReference('RevitAPI')
from Autodesk.Revit.DB import *
from Autodesk.Revit.DB.Structure import *

clr.AddReference('RevitServices')
import RevitServices
from RevitServices.Persistence import DocumentManager
from RevitServices.Transactions import TransactionManager

class WallData :

    def __init__(self, thickness, start, end, height) :

        self.thickness = str(thickness)
        self.startPoint = {"X" : str(start.X), "Y" : str(start.Y), "Z" : str(start.Z)}
        self.endPoint = {"X" : str(end.X), "Y" : str(end.Y), "Z" : str(end.Z)}
        self.height = str(height)
    
    def toDict(self) :
        
        return {"Thickness" : self.thickness, "Start" : self.startPoint, "End" : self.endPoint, "Height" : self.height}

def getLocationData(location) :

    data = []

    if hasattr(location, 'Curve') :
                
        curve = location.Curve
                
        if isinstance(curve, Line) :

            startXYZ = curve.GetEndPoint(0)
            endXYZ   = curve.GetEndPoint(1)

            # startPoint = [startXYZ.X, startXYZ.Y, startXYZ.Z]
            # endPoint   = [endXYZ.X, startXYZ.Y, startXYZ.Z]

            return startXYZ, endXYZ
        
            # data.append(endPoint)
    
    return None, None

def getUnconnectedHeight(wall) :

    parameter = wall.LookupParameter("Unconnected Height")
    return parameter.AsDouble()

def getTotalThickness(wall, document) :

    wallType = document.GetElement(wall.GetTypeId())
    compoundStructure = wallType.GetCompoundStructure()
    totalThickness = compoundStructure.GetWidth()
    return totalThickness

def getSerializingData(wallsList, document) :
    
    data = []
    
    TransactionManager.Instance.EnsureInTransaction(document)
    
    for iterator in range(len(wallsList)) :
        
        # try :
        
        wall = wallsList[iterator]

        totalThickness = getTotalThickness(wall, document)

        unconnectedHeight = getUnconnectedHeight(wall)

        location       = wall.Location

        startXYZ, endXYZ = getLocationData(location)

        wallData = WallData(totalThickness, startXYZ, endXYZ, unconnectedHeight)

        data.append(wallData.toDict())
                
        # except : pass
        
    TransactionManager.Instance.TransactionTaskDone()
    
    return data

document = DocumentManager.Instance.CurrentDBDocument

walls = FilteredElementCollector(document).OfClass(Wall).WhereElementIsNotElementType().ToElements()

wallsList = list(walls)

data = getSerializingData(wallsList, document)

file_path = "C:\\Users\\Public\\Documents\\WallData.json"

with open(file_path, 'w') as file:
    json.dump(data, file, indent=4)

OUT = "Success"
# ----------------------------------------
